# Grasshopper definition Plan_Configuration.gh (Grasshopper 1.0.7)
# plug-ins: GH_CPython

ladybug = Ladybug_Ladybug()  # -> out; plug-in component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
number_slider = Slider(0, range=0..100)
number_slider_2 = Slider(8, range=0..10)
open_weather_file = Ladybug_OpenEPWWeatherFile(open=Toggle(True))  # -> epwFile; plug-in component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
unit_y = UnitY(Factor=1)
importlocation = Ladybug_ImportLocation(epwFile=open_weather_file)  # -> location; plug-in component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
subtraction = Subtraction(A=number_slider_2, B=number_slider)
series = Series(Start=Slider(7, range=0..10), Step=1, Count=Slider(14, range=0..20))
addition = Addition(A=subtraction, B="1")
sunpath = Ladybug_SunPath(north=unit_y, location=importlocation, hour=series, day="24", month="12", timeStep=1, dailyOrAnnualSunPath=True)  # -> out, sunVectors, sunAltitudes, sunAzimuths, port, sunSpheresMesh, sunPathCrvs, compassCrvs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; plug-in component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
legendpar = Ladybug_LegendParameters(lowBound=number_slider, highBound=number_slider_2, numSegments=addition)  # -> legendPar; plug-in component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

# ---- group: Room shape with window
geometry = Geometry([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])

# ---- group: Room & corridor shaope with window
geometry_2 = Geometry([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])

# ---- group: Surrounding Buildings
buildings = Geometry([<brep referenced from the Rhino model> x17])

# ----
geometry_3 = Geometry([<brep referenced from the Rhino model> x20])
geometry_4 = Geometry([<brep referenced from the Rhino model> x19])

# ---- group: Merge surrounding building with generated rooms
merge = Merge(Data1=buildings, Data2=geometry_3)

# ---- group: Room shape generator / Press to generate from info file
button = Button()

# ---- group: Room shape generator
cluster = Cluster(input=button)  # -> geometry_3, geometry_2, name_list, light_list, geometry, colour

# ----
unit_y_2 = UnitY(Factor=1)

# ---- group: Site
geometry_5 = Geometry(<brep referenced from the Rhino model>)

# ----
colour_rgb = ColourRGB(Alpha=255, Red="255", Green="255", Blue="255")
sunlighthoursanalysis = Ladybug_SunlightHoursAnalysis(
    north=unit_y_2,
    geometry=flatten(geometry_5),
    context=flatten(merge),
    gridSize="1",
    disFromBase="0.9",
    sunVectors=flatten(sunpath.sunVectors),
    timeStep=1,
    legendPar=flatten(legendpar),
    runIt=Toggle(True))  # -> out, contextMesh, analysisMesh, testPts, testVec, port, sunlightHoursResult, sunlightHoursMesh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; plug-in component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

# ---- group: Room shape generator / Generated rooms
geometry_6 = Geometry(cluster.geometry_3)

# ---- group: Room shape generator / Show room name
text_tag_3d = TextTag3D(Location=cluster.geometry_2, Text=cluster.name_list, Size=1, Colour=cluster.colour, Justification=7)

# ----
text_tag_3d_2 = TextTag3D(Location=cluster.geometry, Text=cluster.light_list, Size=1, Colour=colour_rgb, Justification=7)
meshunitsize = Panel(sunlighthoursanalysis.sunlightHoursResult)

construct_point = ConstructPoint(XCoordinate=0, YCoordinate=0, ZCoordinate=0)
unit_z = UnitZ(Factor=1)
gh_cpython = GH_CPython()  # -> output, cx_list, cy_list, m_list; inputs run: list
#   port output: indicate your output description here. refers to a new line.
# ---------- gh_cpython: Python ----------
# 需要进行抽象化的有：节点（属性有：x y坐标  父节点  g及h ）  地图（属性有高度 宽度  数据(数据中有可通行路径与障碍两种)）
# A_star :
# open_list (存放待测试的点，刚开始有start加入list，后面每一个current的相邻点（不能位于close_list中且不是终点）要放到open_list中) 表示已经走过的点
# close_list(存放已测试的点，已经当过current的点，就放到close_list中) 存放已经探测过的点，不必再进行探测
# current 现在正在测试的点，要计算current周围的点的代价f  经过current后要放到close_list中 将openlist代价f最小的node当作下一个current
# start_point end_point

# 初始化地图  openlist closelist node
# 将start点放入openlist中
# while（未达到终点）：
# 取出 openlist 中的点 将这个点设置为current 并放入closelist中
# for node_near in（current的临近点）
# if（current的临近点 node_near 不在closelist中且不为障碍）：
# 计算 node_near 的f（f=g+h）大小
# if( node_near 不在 openlist 中)
# 将 node_near 放入 openlist，并将其父节点设置为current 然后将f值设置为计算出的f值
# else if( node_near 在 openlist 中)
#  if（计算出的f大于在openlist中的f）
#    不动作
#  else if（计算出的f小于等于在openlist中的f）
#     将 openlist 中的 node_near 的f值更新为计算出的新的更小的f值 并将父节点设置为current
# 返回并继续循环
import sys


# 将地图中的点抽象化成类
class Point:
    def __init__(self, x, y):
        self.x = x
        self.y = y

    def __eq__(self, other):  # 函数重载
        if ((self.x == other.x) and (self.y == other.y)):
            return 1
        else:
            return 0


# 通过列表实现的地图的建立
class map_2d:
    def __init__(self, height, width):
        self.height = height
        self.width = width
        self.data = []
        self.data = [[0 for i in range(width)] for j in range(height)]

    def map_show(self):
        for j in range(self.height):
            for i in range(self.width):
                print(self.data[j][i], end=' ')
            print("")

    def obstacle(self, obstacle_x, obstacle_y):
        self.data[obstacle_x][obstacle_y] = 1

    def end_draw(self, point):
        self.data[point.x][point.y] = 6


# A*算法的实现
class A_star:
    # 设置node
    class Node:
        def __init__(self, point, endpoint, g):
            self.point = point  # 自己的坐标
            self.endpoint = endpoint  # 自己的坐标
            self.father = None  # 父节点
            self.g = g  # g值，g值在用到的时候会重新算
            self.h = (abs(endpoint.x - point.x) + abs(endpoint.y - point.y)) * 10  # 计算h值
            self.f = self.g + self.h

        # 寻找临近点
        def search_near(self, ud, rl):  # up  down  right left
            nearpoint = Point(self.point.x + rl, self.point.y + ud)
            nearnode = A_star.Node(nearpoint, self.endpoint, self.g + 1)
            return nearnode

    def __init__(self, start_point, end_point, map):  # 需要传输到类中的，在此括号中写出
        self.path = []
        self.close_list = []  # 存放已经走过的点
        self.open_list = []  # 存放需要尽心探索的点
        self.current = 0  # 现在的node
        self.start_point = start_point
        self.end_point = end_point
        self.map = map  # 所在地图

    def select_current(self):
        min = 10000000
        node_temp = 0
        for ele in self.open_list:
            if ele.f < min:
                min = ele.f
                node_temp = ele
        self.path.append(node_temp)
        self.open_list.remove(node_temp)
        self.close_list.append(node_temp)
        return node_temp

    def isin_openlist(self, node):
        for opennode_temp in self.open_list:
            if opennode_temp.point == node.point:
                return opennode_temp
        return 0

    def isin_closelist(self, node):
        for closenode_temp in self.close_list:
            if closenode_temp.point == node.point:
                return 1
        return 0

    def is_obstacle(self, node):
        if self.map.data[node.point.x][node.point.y] == 1:
            return 1
        return 0

    def near_explore(self, node):
        ud = 0
        rl = 1
        node_temp = node.search_near(ud, rl)  # 在调用另一个类的方法时（不论是子类还是在类外定义的类），都要进行实例化才能调用函数
        if node_temp.point == end_point:
            return 1
        elif self.isin_closelist(node_temp):
            pass
        elif self.is_obstacle(node_temp):
            pass
        elif self.isin_openlist(node_temp) == 0:
            node_temp.father = node
            self.open_list.append(node_temp)
        else:
            if node_temp.f < (self.isin_openlist(node_temp)).f:
                self.open_list.remove(self.isin_openlist(node_temp))
                node_temp.father = node
                self.open_list.append(node_temp)

        ud = 0
        rl = -1
        node_temp = node.search_near(ud, rl)  # 在调用另一个类的方法时（不论是子类还是在类外定义的类），都要进行实例化才能调用函数
        if node_temp.point == end_point:
            return 1
        elif self.isin_closelist(node_temp):
            pass
        elif self.is_obstacle(node_temp):
            pass
        elif self.isin_openlist(node_temp) == 0:
            node_temp.father = node
            self.open_list.append(node_temp)
        else:
            if node_temp.f < (self.isin_openlist(node_temp)).f:
                self.open_list.remove(self.isin_openlist(node_temp))
                node_temp.father = node
                self.open_list.append(node_temp)
        ud = 1
        rl = 0
        node_temp = node.search_near(ud, rl)  # 在调用另一个类的方法时（不论是子类还是在类外定义的类），都要进行实例化才能调用函数
        if node_temp.point == end_point:
            return 1
        elif self.isin_closelist(node_temp):
            pass
        elif self.is_obstacle(node_temp):
            pass
        elif self.isin_openlist(node_temp) == 0:
            node_temp.father = node
            self.open_list.append(node_temp)
        else:
            if node_temp.f < (self.isin_openlist(node_temp)).f:
                self.open_list.remove(self.isin_openlist(node_temp))
                node_temp.father = node
                self.open_list.append(node_temp)

        ud = -1
        rl = 0
        node_temp = node.search_near(ud, rl)  # 在调用另一个类的方法时（不论是子类还是在类外定义的类），都要进行实例化才能调用函数
        if node_temp.point == end_point:
            return 1
        elif self.isin_closelist(node_temp):
            pass
        elif self.is_obstacle(node_temp):
            pass
        elif self.isin_openlist(node_temp) == 0:
            node_temp.father = node
            self.open_list.append(node_temp)
        else:
            if node_temp.f < (self.isin_openlist(node_temp)).f:
                self.open_list.remove(self.isin_openlist(node_temp))
                node_temp.father = node
                self.open_list.append(node_temp)

        return 0


def draw_obstacle(map, G, order, rooms_shape_list_ops):
    def room_obstacle(center_pos_x, center_pos_y, width, length):
        mp_width = int(length/10)
        mp_length = int(width/10)
        for len in range(mp_length):
            for wid in range(mp_width):
                obstacle_x = int(wid + center_pos_x/10  - width/10 / 2)
                obstacle_y = int(len + center_pos_y/10  - length/10 / 2)
                map.obstacle(96 - obstacle_y, obstacle_x)

    for room in order:
        def crack(integer):
            start = int(np.sqrt(integer))
            factor = integer / start
            while not is_integer(factor):
                start += 1
                factor = integer / start
            return int(factor), start

        def is_integer(number):
            if int(number) == number:
                return True
            else:
                return False

        i = order.index(room)
        node = order[i]
        s = G.nodes[node]['sizes']
        ret = crack(s)  # crack room size into two closest factors
        room_width = ret[1] * 10
        room_length = ret[0] * 10
        pos = rooms_shape_list_ops[i]
        pos_x = pos[0]
        pos_y = 960 - pos[1]
        room_obstacle(pos_x, pos_y, room_width, room_length)


def door_pair(G, order, rooms_shape_list_ops):
    def door_position(room_node, center_pos_x, center_pos_y, width, length):
        direction = G.nodes[room_node]['door_direction']
        if direction == 'N':
            door_x = int(center_pos_x/10 )
            door_y = int(center_pos_y/10  + length/10 / 2)
        elif direction == 'S':
            door_x = int(center_pos_x/10)
            door_y = int(center_pos_y/10 - length/10 / 2)
        elif direction == 'E':
            door_x = int(center_pos_x/10 + width/10 / 2)
            door_y = int(center_pos_y/10)
        elif direction == 'W':
            door_x = int(center_pos_x/10 - width/10 / 2)
            door_y = int(center_pos_y/10)
        else:
            door_x = int(center_pos_x/10)
            door_y = int(center_pos_y/10 + length/10/ 2)
        # door_x = int(center_pos_x / 10)
        # door_y = int(center_pos_y / 10)
        door_pos = (door_x, door_y)
        return door_pos

    def crack(integer):
        start = int(np.sqrt(integer))
        factor = integer / start
        while not is_integer(factor):
            start += 1
            factor = integer / start
        return int(factor), start

    def is_integer(number):
        if int(number) == number:
            return True
        else:
            return False

    pair_list = []

    f = [e for e in G.edges]
    for i in range(len(f)):

        a = f[i][0]
        g = order.index(a)
        sa = G.nodes[a]['sizes']
        ret = crack(sa)  # crack room size into two closest factors
        a_room_width = ret[1] * 10
        a_room_length = ret[0] * 10
        pos_a = rooms_shape_list_ops[g]
        pos_a_x = pos_a[0]
        pos_a_y = 960 - pos_a[1]
        start_pos = door_position(a, pos_a_x, pos_a_y, a_room_width, a_room_length)

        b = f[i][1]
        k = order.index(b)
        sb = G.nodes[b]['sizes']
        ret = crack(sb)  # crack room size into two closest factors
        b_room_width = ret[1] * 10
        b_room_length = ret[0] * 10
        pos_b = rooms_shape_list_ops[k]
        pos_b_x = pos_b[0]
        pos_b_y = 960 - pos_b[1]
        end_pos = door_position(b, pos_b_x, pos_b_y, b_room_width, b_room_length)
        pair_list.append([start_pos, end_pos])


    # for room in order:
    #
        # pair_temp = []
        # g = order.index(room)
        # node = order[g]
        # s = G.nodes[node]['sizes']
        # ret = crack(s)  # crack room size into two closest factors
        # room_width = ret[1] * 10
        # room_length = ret[0] * 10
        # pos_g = rooms_shape_list_ops[g]
        # pos_g_x = pos_g[0]
        # pos_g_y = 960 - pos_g[1]
        # start_pos = door_position(node, pos_g_x, pos_g_y, room_width, room_length)
        # f = [n for n in G.neighbors(node)]  # getting neighbors of node i
    #
    #     for i_f in range(len(f)):
    #         for k in order[0:g]:
    #             if k == f[i_f]:
    #                 # weight = G[node][f[k]]['weight']  # getting weight of edge connected to node i
    #                 sk = G.nodes[k]['sizes']
    #                 ret = crack(sk)  # crack room size into two closest factors
    #                 room_width = ret[0] * 10
    #                 room_length = ret[1] * 10
    #
    #                 pos_k = rooms_shape_list_ops[k]
    #                 pos_k_x = pos_k[0]
    #                 pos_k_y = pos_k[1]
    #                 print((pos_g_x,pos_g_y),(pos_k_x, pos_k_y))
    #
    #                 end_pos = door_position(k, pos_k_x, pos_k_y, room_width, room_length)
    #                 pair_temp.append(start_pos)
    #                 pair_temp.append(end_pos)
    #                 pair_list.append(pair_temp)
    #                 pair_temp = []
    #                 print(start_pos,end_pos)
    #             else:
    #                 pass

    return pair_list



import numpy as np
import networkx as nx


def convert(lst):
    return eval(lst)


def por_to_graph(rooms, sizes, lights, door_direction, circulations, cir_Weight):
    i_sizes = 0
    i_lights = 1
    i_weight_sum = 2
    i_edge_sum = 3
    i_door_direction = 4

    ReL_Array = np.zeros([len(rooms), len(rooms)])
    Attri_Array = np.zeros([len(rooms), i_door_direction + 1])

    # creating ReL_Array
    for i in range(len(rooms)):
        for a in range(len(circulations)):
            for b in range(len(circulations[a]) - 1):
                if circulations[a][b] == rooms[i]:
                    ReL_Array[i, rooms.index(circulations[a][b + 1])] += cir_Weight[a]

    # Flip the array left and right then rotate the array by 90 degrees
    ReL_Array = ReL_Array + np.rot90(np.fliplr(ReL_Array))
    # print("ReL_Array = ", ReL_Array)

    # Creating attribute array
    for i in range(len(rooms)):
        Attri_Array[i, i_sizes] = sizes[i]
        Attri_Array[i, i_lights] = lights[i]
    # print("Attri_Array = ", Attri_Array)

    # get Sum of edge weights on one node
    sum_weight = []
    for i in range(len(rooms)):
        sum_weight.append(sum(ReL_Array[i]))

    # Creating graph in networkx from ReL_Array
    G = nx.from_numpy_array(ReL_Array)
    for i in range(len(rooms)):
        G.nodes[i]['room'] = rooms[i]
        G.nodes[i]['sizes'] = sizes[i]
        G.nodes[i]['lights'] = lights[i]
        G.nodes[i]['sum_weight'] = sum_weight[i]
        G.nodes[i]['door_direction'] = door_direction[i]

    print("G.edges = ", G.edges(data=True))  # print edges
    print("G.nodes = ", G.nodes(data=True))  # print all nodes with attribute dictionary
    print("G.degree() = ", G.degree())
    print("sum_weight = ", sum_weight)
    return G


f = open('D:\\Delft Courses\\Graduation\\PythonProject\\4_5_info_exchange.txt', mode='r', encoding='utf-8')
infolist = []
for line in f:
    infolist.append(line.strip())

phase_index = infolist[0]
rooms_shape_list_ops = eval(infolist[1])
body_type_list = eval(infolist[2])
order = eval(infolist[3])
rooms = eval(infolist[4])
sizes = eval(infolist[5])
lights = eval(infolist[6])
# door_direction = eval(infolist[7])
door_direction = ['S','S','S','S','S']
circulations = eval(infolist[8])
cir_Weight = eval(infolist[9])

G = por_to_graph(rooms, sizes, lights, door_direction, circulations, cir_Weight)

##建图并设立障碍
mw = 96
mh = 160
ss = map_2d(mw, mh)

cx_list = []
cy_list = []
m_list = []
point_con = []

draw_obstacle(ss,G, order, rooms_shape_list_ops)
ss.map_show()

# set path finding pairing points
pair_list = door_pair(G, order, rooms_shape_list_ops)
print(pair_list)

h = len(pair_list)
print(h)

for i in range(h):
    point_s = Point(pair_list[i][0][0], 96 - pair_list[i][0][1])
    point_e = Point(pair_list[i][1][0], 96 - pair_list[i][1][1])
    point_con.append([point_s, point_e])


for i in range(len(point_con)):
    start_point = point_con[i][0]
    end_point = point_con[i][1]
    ss.end_draw(end_point)
    ss.end_draw(start_point)

    a_star = A_star(start_point, end_point, ss)  # 初始化设置A*
    start_node = a_star.Node(start_point, end_point, 0)
    a_star.open_list.append(start_node)

    flag = 0  # 到达终点的标志位
    m = 0  # 步数统计
    cx = 0
    cy = 0

    while flag != 1:  # 进入循环
        a_star.current = a_star.select_current()  # 从openlist中选取一个node
        flag = a_star.near_explore(a_star.current)  # 对选中的node进行周边探索
        m = m + 1

    # print("Step =", m)
    m_list.append(m + 1)

    for node_path in a_star.path:  # 画出地图路径
        ss.end_draw(node_path.point)
        cx = node_path.point.x
        cy = node_path.point.y
        cx_list.append(cx)
        cy_list.append(cy)
        # print(cx, ",", cy)
    cx_list.append(end_point.x)
    cy_list.append(end_point.y)

jj = map_2d(mw, mh)

# set obstacle
draw_obstacle(jj, G, order, rooms_shape_list_ops)

for i in range(len(cx_list)):
    jj.obstacle(cy_list[i], cx_list[i])

jj.map_show()

print(order)
print(door_direction)
# ---------- end gh_cpython ----------
subtraction_2 = Subtraction(A=Slider(96, range=0..100), B=gh_cpython.cy_list)
line_sdl = LineSDL(Start=construct_point, Direction=unit_z, Length=1)
construct_point_2 = ConstructPoint(XCoordinate=gh_cpython.cx_list, YCoordinate=subtraction_2, ZCoordinate=0)
partition_list = PartitionList(List=construct_point_2, Size=gh_cpython.m_list)
number_slider_3 = Slider(90, range=0..100)
rotate_axis = RotateAxis(Geometry=construct_point_2, Angle=degrees("-26"), Axis=line_sdl)  # -> Geometry, Transform
polyline = PolyLine(Vertices=partition_list, Closed=False)
geometry_7 = Geometry(rotate_axis.Geometry)

map_height = Slider(96, range=0..100)
map_width = Slider(160, range=0..10000)
data = Data(sunlighthoursanalysis.sunlightHoursResult)
_04_initial_room_placement_module = Map_draw(daylighthours=data, map_height=map_height, map_width=map_width)  # inputs daylighthours: list, map_height: list, map_width: list; disabled
#   port daylighthours: [required] - [type = int] - [default = None] Descripe your input here * bullet point. * bullet point
# ---------- _04_initial_room_placement_module: Python ----------
# Process PoR into Graph with attributes

import numpy as np
import networkx as nx
import matplotlib.pyplot as plt
import os

import sys

import inspect
import math

import pygame
from pygame.color import *
from pygame.locals import *

import pymunk
import pymunk as pm
from pymunk.vec2d import Vec2d
import pymunk.pygame_util
import pymunk.autogeometry


def draw_helptext(screen):
    font = pygame.font.Font(None, 20)
    text = ["LMB(hold): Drag shapes",
            "Initial_room_placement_module",
            "P: Pause",
            "During Pause: G: generate iteration file",
            "Esc / Q: Quit",
            "After pressing G, quit module to proceed to Daylight Daylight_hour_optimization_module"
            ]
    y = 5
    for line in text:
        text = font.render(line, 1, THECOLORS["black"])
        screen.blit(text, (5, y))
        y += 15


def draw_graph(graph):
    # draw graph with weight
    pos = nx.spring_layout(graph)
    nx.draw(graph, pos)
    node_labels = nx.get_node_attributes(graph, 'room')
    nx.draw_networkx_labels(graph, pos, labels=node_labels)
    labels = nx.get_edge_attributes(graph, 'weight')
    nx.draw_networkx_edge_labels(graph, pos, edge_labels=labels)
    plt.show()
    pass
# ↑ done, draws the graph


def por_to_graph(rooms, sizes, lights, door_direction, circulations, cir_Weight):
    i_sizes = 0
    i_lights = 1
    i_weight_sum = 2
    i_edge_sum = 3
    i_door_direction = 4

    ReL_Array = np.zeros([len(rooms), len(rooms)])
    Attri_Array = np.zeros([len(rooms), i_door_direction + 1])

    # creating ReL_Array
    for i in range(len(rooms)):
        for a in range(len(circulations)):
            for b in range(len(circulations[a]) - 1):
                if circulations[a][b] == rooms[i]:
                    ReL_Array[i, rooms.index(circulations[a][b + 1])] += cir_Weight[a]

    # Flip the array left and right then rotate the array by 90 degrees
    ReL_Array = ReL_Array + np.rot90(np.fliplr(ReL_Array))
    # print("ReL_Array = ", ReL_Array)

    # Creating attribute array
    for i in range(len(rooms)):
        Attri_Array[i, i_sizes] = sizes[i]
        Attri_Array[i, i_lights] = lights[i]
    # print("Attri_Array = ", Attri_Array)

    # get Sum of edge weights on one node
    sum_weight = []
    for i in range(len(rooms)):
        sum_weight.append(sum(ReL_Array[i]))

    # Creating graph in networkx from ReL_Array
    G = nx.from_numpy_array(ReL_Array)
    for i in range(len(rooms)):
        G.nodes[i]['room'] = rooms[i]
        G.nodes[i]['sizes'] = sizes[i]
        G.nodes[i]['lights'] = lights[i]
        G.nodes[i]['sum_weight'] = sum_weight[i]
        G.nodes[i]['door_direction'] = door_direction[i]

    print("G.edges = ", G.edges(data=True))  # print edges
    print("G.nodes = ", G.nodes(data=True))  # print all nodes with attribute dictionary
    print("G.degree() = ", G.degree())
    print("sum_weight = ", sum_weight)
    return G
# ↑ done, returns a graph contains all information, weights on edges, attributes on nodes


def site_daylight_map(daylighthours, map_height):
    '''
    site_daylight_map = site_daylight_map(daylighthours, map_height, map_width)
    site_daylight_map = site_daylight_map.tolist()

    These two lines should be used at the end of the code in GH_CPython components,
    to pass arrays among GH_CPython components within grasshopper in the form of list.
    :param daylighthours: "sunlightHoursResult" list received from Ladybug Tools "sunlightHoursAnalysis" component,
    :param map_height:  Number of grid on y axis
    :return: A numpy array of "sunlightHoursResult" that corresponds to the site
    '''
    daylight_map = [daylighthours[i:i + map_height] for i in range(0, len(daylighthours), map_height)]
    np_daylight_map = np.array(daylight_map)
    np_daylight_map = np.rot90(np_daylight_map)  # match the numpy array with the site
    return np_daylight_map
# ↑ done, returns a numpy array, in the form of site grid.


def from_list_to_array(list, array_width):
    '''
    Arrays are passed in the form of one dimensional list, each time receiving the one dimensional list,
    it needs to be transformed back to two dimensional array.
    :param list: Array received
    :param array_width: Original width of numpy array
    :return: The original numpy array
    '''
    array = [list[i:i + array_width] for i in range(0, len(list), array_width)]
    array = np.array(array)
    return array
# ↑ done, used for passing arrays among GH_CPython components within grasshopper.


def room_placement_order(graph, rooms):
    # Order of Placement
    lst_sum_weight = []
    lst_degree = []
    lst_size = []
    for i in range(len(rooms)):
        lst_sum_weight.append(graph.nodes[i]['sum_weight'])
        lst_degree.append(graph.degree[i])

    lst = [lst_sum_weight, lst_degree, sizes, rooms]

    lst_rev = [[] for _ in range(len(lst[0]))]
    # print('lst_rev = ', lst_rev)
    for i in range(len(lst)):
        for a in range(len(lst[i])):
            lst_rev[a].append(lst[i][a])

    d = sorted(lst_rev, key=lambda x: (-x[0], x[1], -x[2]))
    # print("d = ", d)

    # get the room placement order(in node index)
    order = []
    for i in range(len(d)):
        a = rooms.index(d[i][-1])
        order.append(a)

    return order
# ↑ done, returns a list of node in the order of placement


def add_room_dynamic(space, room_dimension, position, i):
    '''
    Add a dynamic room to space
    :param space:
    :param room:
    :param room_dimension: Dimension: (width, length); or size: integer.
    :param position: coordinate: (x, y)
    :return: body of the room
    '''
    inf = pm.inf

    def crack(integer):
        start = int(np.sqrt(integer))
        factor = integer / start
        while not is_integer(factor):
            start += 1
            factor = integer / start
        return int(factor), start

    def is_integer(number):
        if int(number) == number:
            return True
        else:
            return False

    if type(room_dimension) == 'tuple':
        room_width = room_dimension[0]*10
        room_length = room_dimension[1]*10

    else:
        ret = crack(room_dimension)  # crack room size into two closest factors
        room_width = ret[0]*10
        room_length = ret[1]*10

    mass = (room_width * room_length) * 0.01
    poly_shape = pm.Poly.create_box(None, size=(room_width, room_length))
    poly_body = pm.Body(mass, inf)
    poly_shape.body = poly_body
    poly_body.position = Vec2d(position)
    poly_shape.friction = 0.3
    poly_shape.collision_type = 9
    return poly_body, poly_shape
# ↑ done, add a dynamic room to space


def add_spring(space, a1, a2, weight,length):
    index = 50     # the index to scale the stiffness of the spring according to the weight
    spring = pm.DampedSpring(a1, a2, (0, 0), (0, 0), length, weight * index, 0.3)
    space.add(spring)


def room_placement(screen, space, graph, room_placement_order):
    '''
    初始形体生成模块：
    - 空间里生成房间，连上spring
    - 输出所有房间位置，形体信息，spring设置信息，发给日照优化模块
    :param space:
    :param graph:
    :param room_placement_order:
    :return:
    '''
    rooms_shape_list = []
    spring_list = []
    for i in room_placement_order:  # order =  [4, 1, 0, 2, 3]
        s = G.nodes[i]['sizes']
        g = room_placement_order.index(i)
        lst_len = len(room_placement_order)
        exec(f'a{i}, b{i} = add_room_dynamic(space, s, (800+100*(-1)**g, 960 - g*(960/lst_len)), {i})')
        exec(f'space.add(a{i},b{i})')
        # exec(f'print(a{i}.position)')
        # exec(f'print(b{i}.get_vertices())')
        exec(f'rooms_shape_list.append(b{i})')
        exec(f'l{i}= (s*100)**0.05')

        f = [n for n in graph.neighbors(i)] # getting neighbors of node i

        for i_f in range(len(f)):
            for k in room_placement_order[0:g]:
                if k == f[i_f]:
                    weight = G[i][f[i_f]]['weight']    # getting weight of edge connected to node i
                     # if room is inside space:
                    h = f[i_f]
                    sh = G.nodes[h]['sizes']
                    exec(f'l{h} = (sh*100)**0.05')
                    exec(f'length = (l{i} + l{h})')
                    exec (f'add_spring(space, a{h}, a{i}, weight, length)')
                    exec(f'spring_list.append((a{h}, a{i}))')
                else:
                    pass
    return  rooms_shape_list, spring_list

# ↑ WIP,    输出所有房间名称，位置，形体信息，给rhino模块；房间名称，位置，形体信息，spring设置信息，发给日照优化模块
#   room_name_list = []
#   room_body_list = []
#   room_size_list = []
#   room_type_list = []
#   room_position_list = []
#   spring_room_list = []
#   spring_stiffness_list = []


def draw_room(screen, rooms_shape_list, spring_list):
    # draw pygame rectangles
    for room in rooms_shape_list:
        i = rooms_shape_list.index(room)
        o = order[i]
        s = G.nodes[o]['sizes']

        def crack(integer):
            start = int(np.sqrt(integer))
            factor = integer / start
            while not is_integer(factor):
                start += 1
                factor = integer / start
            return int(factor), start

        def is_integer(number):
            if int(number) == number:
                return True
            else:
                return False

        ret = crack(s)  # crack room size into two closest factors
        room_width = ret[0] * 10
        room_length = ret[1] * 10

        v = room.body.position
        vx = int(v.x - room_width / 2)
        vy = int(v.y - room_length / 2)
        pygame.draw.rect(screen, THECOLORS["red"], (vx, vy, room_width, room_length), 4)

        font = pygame.font.Font(None, 16)
        name = G.nodes[o]['room']
        text = font.render(name, 1, THECOLORS["black"])
        screen.blit(text, (vx, vy))

    for joint in spring_list:
        for i in range(len(spring_list)):
            ax = int(joint[0].position.x)
            ay = int(joint[0].position.y)
            bx = int(joint[1].position.x)
            by = int(joint[1].position.y)
            pygame.draw.line(screen, (0, 0, 255), (ax, ay), (bx, by), 3)
# ↑ done, draw all rooms and connections with pygame


def main():
    # initialize the environment
    pm.pygame_util.positive_y_is_up = False

    pygame.init()
    screen = pygame.display.set_mode((1600, 960))
    clock = pygame.time.Clock()

    space = pm.Space()
    space.gravity = (0.0, 0.0)
    # draw_options = pm.pygame_util.DrawOptions(screen)

    fps = 60

    static = [
        pm.Segment(space.static_body, (0, 0), (0, 960), 5),
        pm.Segment(space.static_body, (0, 960), (1600, 960), 5),
        pm.Segment(space.static_body, (1600, 960), (1600, 0), 5),
        pm.Segment(space.static_body, (0, 0), (1600, 0), 5),
    ]

    for s in static:
        s.collision_type = 0
    space.add(static)

    mouse_joint = None
    mouse_body = pm.Body(body_type=pm.Body.KINEMATIC)

    rooms_shape_list, spring_list = room_placement(screen, space, G, order)





    while True:
        pause = False
        for event in pygame.event.get():
            if event.type == KEYUP:
                if event.key == K_p:
                    pause = True
            if event.type == QUIT:
                exit()
            elif event.type == KEYDOWN and event.key == K_ESCAPE:
                exit()
            elif event.type == MOUSEBUTTONDOWN:
                if mouse_joint != None:
                    space.remove(mouse_joint)
                    mouse_joint = None

                p = Vec2d(event.pos)
                hit = space.point_query_nearest(p, 5, pm.ShapeFilter())
                if hit != None and hit.shape.body.body_type == pm.Body.DYNAMIC:
                    shape = hit.shape
                    # Use the closest point on the surface if the click is outside
                    # of the shape.
                    if hit.distance > 0:
                        nearest = hit.point
                    else:
                        nearest = p
                    mouse_joint = pm.PivotJoint(mouse_body, shape.body,
                                                    (0, 0), shape.body.world_to_local(nearest))
                    mouse_joint.max_force = 5000000
                    mouse_joint.error_bias = (1 - 0.15) ** 60
                    space.add(mouse_joint)

            elif event.type == MOUSEBUTTONUP:
                if mouse_joint != None:
                    space.remove(mouse_joint)
                    mouse_joint = None

        while pause == True:
            for event in pygame.event.get():
                if event.type == KEYUP:
                    if event.key == K_p:
                        pause = False
                if event.type == QUIT:
                    exit()
                elif event.type == KEYDOWN and event.key == K_ESCAPE:
                    exit()
                elif event.type == KEYDOWN and event.key == K_g:    # 判断按下g

                    phase_index = 0
                    rooms_shape_list_pos_out = []
                    body_type_list_out = []
                    room_info_lst = []
                    order_generate = []

                    for shape in rooms_shape_list:
                        i = rooms_shape_list.index(shape)
                        room = order[i]
                        v = shape.body.position
                        vx = int(v.x)
                        vy = int(v.y)
                        body_type = shape.body.body_type
                        shape_pos = (vx, vy)

                        room_info = (room, shape_pos, body_type, i,vy)
                        room_info_lst.append(room_info)

                    order_info_lst = sorted(room_info_lst, key=lambda x: (-x[4], x[3]))

                    for i in range(len(order_info_lst)):
                        room_node = order_info_lst[i][0]
                        shape_pos_order = order_info_lst[i][1]
                        body_type_order = order_info_lst[i][2]
                        order_generate.append(room_node)
                        rooms_shape_list_pos_out.append(shape_pos_order)
                        body_type_list_out.append(body_type_order)

                    f = open('D:\\Delft Courses\\Graduation\\PythonProject\\4_5_info_exchange.txt', mode='w', encoding='utf-8')
                    f.write(f'{phase_index}')
                    f.write('\n')
                    f.write(f'{rooms_shape_list_pos_out}')
                    f.write('\n')
                    f.write(f'{body_type_list_out}')
                    f.write('\n')
                    f.write(f'{order_generate}')
                    f.write('\n')
                    f.write(f'{rooms}')
                    f.write('\n')
                    f.write(f'{sizes}')
                    f.write('\n')
                    f.write(f'{lights}')
                    f.write('\n')
                    f.write(f'{door_direction}')
                    f.write('\n')
                    f.write(f'{circulations}')
                    f.write('\n')
                    f.write(f'{cir_Weight}')
                    print(order_generate)


        screen.fill(pygame.color.THECOLORS["white"])

        draw_room(screen, rooms_shape_list, spring_list)
        draw_helptext(screen)

        mouse_pos = pygame.mouse.get_pos()

        mouse_body.position = mouse_pos

        space.step(1. / fps)

        # space.debug_draw(draw_options)
        pygame.display.flip()

        clock.tick(fps)
        pygame.display.set_caption("fps: " + str(clock.get_fps()))




rooms = ["RoomA", "RoomB", "RoomC", "RoomD", "RoomE"]
sizes = [100, 50, 30, 40, 80]
lights = [8, 7, 6, 5, 4]
door_direction = ["N", "none", "none", "none", "W"]
circulations = [["RoomA", "RoomB", "RoomE", "RoomA"],
                ["RoomB", "RoomD", "RoomC", "RoomE", "RoomB"],
                ["RoomA", "RoomB", "RoomC", "RoomE", "RoomA"]]
cir_Weight = [3, 1, 2]

G = por_to_graph(rooms, sizes, lights, door_direction, circulations, cir_Weight)

order = room_placement_order(G, rooms)

global order_list_out
global rooms_shape_list_out
global spring_list_out

# print("order = ", order)

# draw_graph(G)

if __name__ == '__main__':
    sys.exit(main())
# ---------- end _04_initial_room_placement_module ----------
_05_daylight_hour_optimization_module = GH_CPython(daylighthours=data, map_height=map_height, map_width=map_width)  # inputs daylighthours: list, map_height: list, map_width: list; disabled
# ---------- _05_daylight_hour_optimization_module: Python ----------
# Process PoR into Graph with attributes

import numpy as np
import networkx as nx
import matplotlib.pyplot as plt

import sys

import inspect
import math

import pygame
from pygame.color import *
from pygame.locals import *

import pymunk
import pymunk as pm
from pymunk.vec2d import Vec2d
import pymunk.pygame_util
import pymunk.autogeometry


def draw_helptext(screen):
    font = pygame.font.Font(None, 20)
    text = ["Daylight_hour_optimization_module",
            "LMB(hold): Drag shapes",
            "P: Pause",
            "During Pause: C: connect spring, then unpause to see reaction",
            "During Pause: G: generate iteration file",
            "Esc / Q: Quit",
            "After final iteration, press G and quit module to proceed"
            ]
    y = 5
    for line in text:
        text = font.render(line, 1, THECOLORS["black"])
        screen.blit(text, (5, y))
        y += 15


def draw_graph(graph):
    # draw graph with weight
    pos = nx.spring_layout(graph)
    nx.draw(graph, pos)
    node_labels = nx.get_node_attributes(graph, 'room')
    nx.draw_networkx_labels(graph, pos, labels=node_labels)
    labels = nx.get_edge_attributes(graph, 'weight')
    nx.draw_networkx_edge_labels(graph, pos, edge_labels=labels)
    plt.show()
    pass
# ↑ done, draws the graph


def por_to_graph(rooms, sizes, lights, door_direction, circulations, cir_Weight):
    i_sizes = 0
    i_lights = 1
    i_weight_sum = 2
    i_edge_sum = 3
    i_door_direction = 4

    ReL_Array = np.zeros([len(rooms), len(rooms)])
    Attri_Array = np.zeros([len(rooms), i_door_direction + 1])

    # creating ReL_Array
    for i in range(len(rooms)):
        for a in range(len(circulations)):
            for b in range(len(circulations[a]) - 1):
                if circulations[a][b] == rooms[i]:
                    ReL_Array[i, rooms.index(circulations[a][b + 1])] += cir_Weight[a]

    # Flip the array left and right then rotate the array by 90 degrees
    ReL_Array = ReL_Array + np.rot90(np.fliplr(ReL_Array))
    # print("ReL_Array = ", ReL_Array)

    # Creating attribute array
    for i in range(len(rooms)):
        Attri_Array[i, i_sizes] = sizes[i]
        Attri_Array[i, i_lights] = lights[i]
    # print("Attri_Array = ", Attri_Array)

    # get Sum of edge weights on one node
    sum_weight = []
    for i in range(len(rooms)):
        sum_weight.append(sum(ReL_Array[i]))

    # Creating graph in networkx from ReL_Array
    G = nx.from_numpy_array(ReL_Array)
    for i in range(len(rooms)):
        G.nodes[i]['room'] = rooms[i]
        G.nodes[i]['sizes'] = sizes[i]
        G.nodes[i]['lights'] = lights[i]
        G.nodes[i]['sum_weight'] = sum_weight[i]
        G.nodes[i]['door_direction'] = door_direction[i]

    print("G.edges = ", G.edges(data=True))  # print edges
    print("G.nodes = ", G.nodes(data=True))  # print all nodes with attribute dictionary
    print("G.degree() = ", G.degree())
    print("sum_weight = ", sum_weight)
    return G
# ↑ done, returns a graph contains all information, weights on edges, attributes on nodes


def site_daylight_map(daylighthours, map_height):
    '''
    site_daylight_map = site_daylight_map(daylighthours, map_height, map_width)
    site_daylight_map = site_daylight_map.tolist()

    These two lines should be used at the end of the code in GH_CPython components,
    to pass arrays among GH_CPython components within grasshopper in the form of list.
    :param daylighthours: "sunlightHoursResult" list received from Ladybug Tools "sunlightHoursAnalysis" component,
    :param map_height:  Number of grid on y axis
    :return: A numpy array of "sunlightHoursResult" that corresponds to the site
    '''
    daylight_map = [daylighthours[i:i + map_height] for i in range(0, len(daylighthours), map_height)]
    np_daylight_map = np.array(daylight_map)
    np_daylight_map = np.rot90(np_daylight_map)  # match the numpy array with the site
    return np_daylight_map
# ↑ done, returns a numpy array, in the form of site grid.


def from_list_to_array(list, array_width):
    '''
    Arrays are passed in the form of one dimensional list, each time receiving the one dimensional list,
    it needs to be transformed back to two dimensional array.
    :param list: Array received
    :param array_width: Original width of numpy array
    :return: The original numpy array
    '''
    array = [list[i:i + array_width] for i in range(0, len(list), array_width)]
    array = np.array(array)
    return array
# ↑ done, used for passing arrays among GH_CPython components within grasshopper.


def room_placement_order(graph, rooms):
    # Order of Placement
    lst_sum_weight = []
    lst_degree = []
    lst_size = []
    for i in range(len(rooms)):
        lst_sum_weight.append(graph.nodes[i]['sum_weight'])
        lst_degree.append(graph.degree[i])

    lst = [lst_sum_weight, lst_degree, sizes, rooms]

    lst_rev = [[] for _ in range(len(lst[0]))]
    # print('lst_rev = ', lst_rev)
    for i in range(len(lst)):
        for a in range(len(lst[i])):
            lst_rev[a].append(lst[i][a])

    d = sorted(lst_rev, key=lambda x: (-x[0], x[1], -x[2]))
    # print("d = ", d)

    # get the room placement order(in node index)
    order = []
    for i in range(len(d)):
        a = rooms.index(d[i][-1])
        order.append(a)

    return order
# ↑ done, returns a list of node in the order of placement


def add_room_static(room_dimension, position):
    '''
    Add a static room to space
    :param room:
    :param room_dimension: Dimension: (width, length); or size: integer.
    :param position: coordinate: (x, y)
    :return: body of the room
    '''
    inf = pm.inf
    def crack(integer):
        start = int(np.sqrt(integer))
        factor = integer / start
        while not is_integer(factor):
            start += 1
            factor = integer / start
        return int(factor), start

    def is_integer(number):
        if int(number) == number:
            return True
        else:
            return False

    if type(room_dimension) == 'tuple':
        room_width = room_dimension[0]*10
        room_length = room_dimension[1]*10

    else:
        ret = crack(room_dimension)  # crack room size into two closest factors
        room_width = ret[0]*10
        room_length = ret[1]*10


    poly_body = pm.Body(body_type=pm.Body.STATIC)
    poly_shape = pm.Poly.create_box(poly_body, size=(room_width, room_length))
    poly_shape.color = (255, 0, 0, 255)  # setting color of the shape
    poly_body.position = Vec2d(position)
    poly_shape.friction = 0.7
    poly_shape.collision_type = 2
    return poly_body, poly_shape
# ↑ done, add a static room to space.


def add_room_dynamic(room_dimension, position):
    '''
    Add a dynamic room to space
    :param space:
    :param room:
    :param room_dimension: Dimension: (width, length); or size: integer.
    :param position: coordinate: (x, y)
    :return: body of the room
    '''
    inf = pm.inf

    def crack(integer):
        start = int(np.sqrt(integer))
        factor = integer / start
        while not is_integer(factor):
            start += 1
            factor = integer / start
        return int(factor), start

    def is_integer(number):
        if int(number) == number:
            return True
        else:
            return False

    if type(room_dimension) == 'tuple':
        room_width = room_dimension[0]*10
        room_length = room_dimension[1]*10

    else:
        ret = crack(room_dimension)  # crack room size into two closest factors
        room_width = ret[0]*10
        room_length = ret[1]*10

    mass = (room_width * room_length) * 0.01
    poly_shape = pm.Poly.create_box(None, size=(room_width, room_length))
    poly_body = pm.Body(mass, inf)
    poly_shape.body = poly_body
    poly_shape.color = (0, 0, 255, 255)  # setting color of the shape
    poly_body.position = Vec2d(position)
    poly_shape.friction = 0.3
    poly_shape.collision_type = 9
    return poly_body, poly_shape
# ↑ done, add a dynamic room to space


def add_spring(space, a1, a2, weight,length):
    index = 50     # the index to scale the stiffness of the spring according to the weight
    spring = pm.DampedSpring(a1, a2, (0, 0), (0, 0), length, weight * index, 0.3)
    space.add(spring)
# ↑ done, add spring


def draw_map(space, site_daylight_map, map_width, map_height):
    def draw_pixel(space, position, lighthour):
        poly_body = pm.Body(body_type=pm.Body.STATIC)
        poly_shape = pm.Poly.create_box(poly_body, size=(10, 10))
        poly_body.position = Vec2d(position)
        poly_shape.friction = 0.7
        if lighthour < 1:
            poly_shape.color = (0, 0, 255, 255)
            poly_shape.filter = pm.ShapeFilter(categories=0b00000000000000001, mask=pm.ShapeFilter.ALL_MASKS^0b00000000100000000)
        elif lighthour < 2:
            poly_shape.color = (67, 0, 189, 255)
            poly_shape.filter = pm.ShapeFilter(categories=0b00000000000000010, mask=pm.ShapeFilter.ALL_MASKS^0b00000001100000000)
        elif lighthour < 3:
            poly_shape.color = (134, 0, 122, 255)
            poly_shape.filter = pm.ShapeFilter(categories=0b00000000000000100, mask=pm.ShapeFilter.ALL_MASKS^0b00000011100000000)
        elif lighthour < 4:
            poly_shape.color = (201, 0, 55, 255)
            poly_shape.filter = pm.ShapeFilter(categories=0b00000000000001000, mask=pm.ShapeFilter.ALL_MASKS^0b00000111100000000)
        elif lighthour < 5:
            poly_shape.color = (255, 12, 0, 255)
            poly_shape.filter = pm.ShapeFilter(categories=0b00000000000010000, mask=pm.ShapeFilter.ALL_MASKS^0b00001111100000000)
        elif lighthour < 6:
            poly_shape.color = (255, 79, 0, 255)
            poly_shape.filter = pm.ShapeFilter(categories=0b00000000000100000, mask=pm.ShapeFilter.ALL_MASKS^0b00011111100000000)
        elif lighthour < 7:
            poly_shape.color = (255, 146, 0, 255)
            poly_shape.filter = pm.ShapeFilter(categories=0b00000000001000000, mask=pm.ShapeFilter.ALL_MASKS^0b00111111100000000)
        elif lighthour < 8:
            poly_shape.color = (255, 213, 0, 255)
            poly_shape.filter = pm.ShapeFilter(categories=0b00000000010000000, mask=pm.ShapeFilter.ALL_MASKS^0b01111111100000000)
        space.add(poly_body, poly_shape)
        return poly_body

    pixel_list = []

    for i in range(map_height - 1):
        for j in range(map_width - 1):
            if site_daylight_map[i][j] < 8:
                draw_pixel(space, (j * 10, i * 10), site_daylight_map[i][j])
                a = (j*10, i*10, site_daylight_map[i][j])
                pixel_list.append(a)

    return pixel_list
# ↑ done, draw map into the space


def draw_map_pg(screen,pixel_list):
    for pixel in pixel_list:
        vx = int(pixel[0] - 5)
        vy = int(pixel[1] - 5)
        lighthour = int(pixel[2])
        if lighthour < 1:  # setting color of the shape
            pygame.draw.rect(screen, (0, 0, 255), (vx, vy, 10, 10))
        elif lighthour < 2:
            pygame.draw.rect(screen, (67, 0, 189), (vx, vy, 10, 10))
        elif lighthour < 3:
            pygame.draw.rect(screen, (134, 0, 122), (vx, vy, 10, 10))
        elif lighthour < 4:
            pygame.draw.rect(screen, (201, 0, 55), (vx, vy, 10, 10))
        elif lighthour < 5:
            pygame.draw.rect(screen, (255, 12, 0), (vx, vy, 10, 10))
        elif lighthour < 6:
            pygame.draw.rect(screen, (255, 79, 0), (vx, vy, 10, 10))
        elif lighthour < 7:
            pygame.draw.rect(screen, (255, 146, 0), (vx, vy, 10, 10))
        elif lighthour < 8:
            pygame.draw.rect(screen, (255, 213, 0), (vx, vy, 10, 10))
# # ↑ done, draw map into the space


def room_placement_dlh(screen, space, graph, phase_index, rooms_shape_list_pos, body_type_list, room_placement_order):
    # phase_index = infolist[0] + 1   # 0+1 = 1
    # rooms_shape_list_pos = infolist[1]  # [(337, 367), (395, 457), (437, 357), (356, 302), (345, 447)]
    # body_type_list = infolist[2]    #   [0, 0, 0, 0, 0]
    rooms_shape_list = []
    rooms_body_list = []
    connection_list = []
    # body_type_list = [2,0,2,0,2]
    for i in room_placement_order:  # order =  [4, 1, 0, 2, 3]
        g = room_placement_order.index(i)
        pos_x = int(rooms_shape_list_pos[g][0])
        pos_y = int(rooms_shape_list_pos[g][1])
        # pos = (pos_x*1.2, pos_y*1.2)
        s = graph.nodes[i]['sizes']
        name = graph.nodes[i]['room']
        # if body_type_list[g] == 2:
        if g < phase_index:
            pos = (pos_x, pos_y)
            exec(f'a{i}, b{i} = add_room_static(s, pos)')
            exec(f'space.add(a{i},b{i})')
            exec(f'rooms_shape_list.append(b{i})')
            exec(f'rooms_body_list.append(a{i})')
        # elif body_type_list[g] == 0:
        else:
            pos = (pos_x, pos_y)
            exec(f'a{i}, b{i} = add_room_dynamic(s, pos)')
            exec(f'space.add(a{i},b{i})')
            exec(f'rooms_shape_list.append(b{i})')
            exec(f'rooms_body_list.append(a{i})')

        exec(f'l{i}= (s*100)**0.05')
        light = graph.nodes[i]['lights']
        if light == 0:
            exec(
                f'b{i}.filter = pm.ShapeFilter(categories=0b00000000100000000, mask=pm.ShapeFilter.ALL_MASKS^0b00000000011111111)')
        elif light == 1:
            exec(
                f'b{i}.filter = pm.ShapeFilter(categories=0b00000001000000000, mask=pm.ShapeFilter.ALL_MASKS^0b00000000011111110)')
        elif light == 2:
            exec(
                f'b{i}.filter = pm.ShapeFilter(categories=0b00000010000000000, mask=pm.ShapeFilter.ALL_MASKS^0b00000000011111100)')
        elif light == 3:
            exec(
                f'b{i}.filter = pm.ShapeFilter(categories=0b00000100000000000, mask=pm.ShapeFilter.ALL_MASKS^0b00000000011111000)')
        elif light == 4:
            exec(
                f'b{i}.filter = pm.ShapeFilter(categories=0b00001000000000000, mask=pm.ShapeFilter.ALL_MASKS^0b00000000011110000)')
        elif light == 5:
            exec(
                f'b{i}.filter = pm.ShapeFilter(categories=0b00010000000000000, mask=pm.ShapeFilter.ALL_MASKS^0b00000000011100000)')
        elif light == 6:
            exec(
                f'b{i}.filter = pm.ShapeFilter(categories=0b00100000000000000, mask=pm.ShapeFilter.ALL_MASKS^0b00000000011000000)')
        elif light == 7:
            exec(
                f'b{i}.filter = pm.ShapeFilter(categories=0b01000000000000000, mask=pm.ShapeFilter.ALL_MASKS^0b00000000010000000)')
        elif light == 8:
            exec(
                f'b{i}.filter = pm.ShapeFilter(categories=0b10000000000000000, mask=pm.ShapeFilter.ALL_MASKS^0b00000000000000000 )')

        f = [n for n in graph.neighbors(i)]  # getting neighbors of node i

        for i_f in range(len(f)):
            for k in room_placement_order[0:g]:
                if k == f[i_f]:
                    # if room is inside space:
                    h = f[i_f]
                    exec(f'connection_list.append((a{h}, a{i}))')
                else:
                    pass
    return rooms_shape_list, rooms_body_list, connection_list


def connect_rooms(space, graph, rooms_body_list, room_placement_order, phase_index):
    spring_list = []
    for body in rooms_body_list:
        g = rooms_body_list.index(body)
        i = room_placement_order[g]
        s = graph.nodes[i]['sizes']
        exec(f'l{g}= (s*100)**0.05')
        f = [n for n in graph.neighbors(i)]  # getting neighbors of node i
        for i_f in range(len(f)):
            for k in room_placement_order[0:g]:
                l = room_placement_order.index(k)
                if k == f[i_f] and (g > phase_index-1 or l > phase_index-1):

                    weight = graph[i][f[i_f]]['weight']  # getting weight of edge connected to node i
                    # if room is inside space:
                    sh = graph.nodes[l]['sizes']
                    exec(f'l{l} = (sh*100)**0.05')
                    exec(f'length = (l{g} + l{l})')
                    exec(f'add_spring(space, rooms_body_list[{l}], rooms_body_list[{g}], weight, length)')
                    exec(f'spring_list.append((rooms_body_list[{l}], rooms_body_list[{g}]))')
                else:
                    pass
    return spring_list



def draw_room(screen, graph, rooms_shape_list, spring_list):
    # draw pygame rectangles
    for room in rooms_shape_list:
        i = rooms_shape_list.index(room)
        o = order[i]
        s = graph.nodes[o]['sizes']
        name = graph.nodes[o]['room']


        def crack(integer):
            start = int(np.sqrt(integer))
            factor = integer / start
            while not is_integer(factor):
                start += 1
                factor = integer / start
            return int(factor), start

        def is_integer(number):
            if int(number) == number:
                return True
            else:
                return False

        ret = crack(s)  # crack room size into two closest factors
        room_width = ret[0] * 10
        room_length = ret[1] * 10


        v = room.body.position
        print(f'{name} pos = {v}')
        vx = int(v.x - room_width / 2)
        vy = int(v.y - room_length / 2)
        pygame.draw.rect(screen, THECOLORS["red"], (vx, vy, room_width, room_length), 2)

        font = pygame.font.Font(None, 16)

        text = font.render(name, 1, THECOLORS["black"])
        screen.blit(text, (vx, vy))


    for joint in spring_list:
        for i in range(len(spring_list)):
            ax = int(joint[0].position.x)
            ay = int(joint[0].position.y)
            bx = int(joint[1].position.x)
            by = int(joint[1].position.y)
            pygame.draw.line(screen, (0, 0, 255), (ax, ay), (bx, by), 3)
# ↑ done, draw all rooms and connections with pygame




def daylight_hour_optimizer():
    '''
    - 输入日照分析地图，输入所有房间的信息，输入被分析的房间的信息
    - 设定被分析房间为STATIC，根据日照分析地图生成STATIC，挤走其余的DYNAMIC
    - 输出所有房间位置，形体信息，spring设置信息
    - 之后所有的信息传输在日照优化模块和Ladybug模块之间进行，只不过迭代时接受的房间位置，形体信息，spring设置信息来自自己。
    - 两个按键，一个用来输出形体信息，一个用来结束优化，输出最终房间位置，形体信息，到走廊生成模块。
    :return:
    '''
# ↑ WIP,


def corridor_generator():
    '''
    - 输入房间位置，形体信息，流线信息。
    - 使用path finding算法生成走廊
    - 使用GA优化开门位置和走廊走向（该部分在P5优化）
    :return:
    '''


def main():
    # initialize the environment
    pm.pygame_util.positive_y_is_up = False

    pygame.init()
    screen = pygame.display.set_mode((1600, 960))
    clock = pygame.time.Clock()

    space = pm.Space()
    space.gravity = (0.0, 0.0)
    # draw_options = pm.pygame_util.DrawOptions(screen)

    fps = 144

    static = [
        pm.Segment(space.static_body, (0, 0), (0, 960), 5),
        pm.Segment(space.static_body, (0, 960), (1600, 960), 5),
        pm.Segment(space.static_body, (1600, 960), (1600, 0), 5),
        pm.Segment(space.static_body, (0, 0), (1600, 0), 5),
    ]

    for s in static:
        s.collision_type = 0
    space.add(static)

    mouse_joint = None
    mouse_body = pm.Body(body_type=pm.Body.KINEMATIC)

    # Draw daylight map in to space
    # Test code
    # f = open('D:\Delft Courses\Graduation\PythonProject\daylighthours.txt', mode='r', encoding='utf-8')
    # daylighthours = []
    # for line in f:
    #     line = line.strip()
    #     daylighthours.append(int(line))
    # 
    # map_height = 96
    # map_width = 160

    sdmap = site_daylight_map(daylighthours, map_height)
    pixel_list = draw_map(space, sdmap, map_width, map_height)


    # rooms_shape_list, spring_list = room_placement(screen, space, G, order)
    rooms_shape_list, rooms_body_list, connection_list= room_placement_dlh(screen, space, G, phase_index, rooms_shape_list_pos, body_type_list, order)
    spring_list = []







    while True:
        pause = False
        for event in pygame.event.get():
            if event.type == KEYUP:
                if event.key == K_p:
                    pause = True
            if event.type == QUIT:
                exit()
            elif event.type == KEYDOWN and event.key == K_ESCAPE:
                exit()
            elif event.type == MOUSEBUTTONDOWN:
                if mouse_joint != None:
                    space.remove(mouse_joint)
                    mouse_joint = None

                p = Vec2d(event.pos)
                hit = space.point_query_nearest(p, 5, pm.ShapeFilter())
                if hit != None and hit.shape.body.body_type == pm.Body.DYNAMIC:
                    shape = hit.shape
                    # Use the closest point on the surface if the click is outside
                    # of the shape.
                    if hit.distance > 0:
                        nearest = hit.point
                    else:
                        nearest = p
                    mouse_joint = pm.PivotJoint(mouse_body, shape.body,
                                                (0, 0), shape.body.world_to_local(nearest))
                    mouse_joint.max_force = 50000000
                    mouse_joint.error_bias = (1 - 0.15) ** 60
                    space.add(mouse_joint)

            elif event.type == MOUSEBUTTONUP:
                if mouse_joint != None:
                    space.remove(mouse_joint)
                    mouse_joint = None

        while pause == True:
            for event in pygame.event.get():
                if event.type == KEYUP:
                    if event.key == K_p:
                        pause = False
                if event.type == QUIT:
                    exit()
                elif event.type == KEYDOWN and event.key == K_ESCAPE:
                    exit()
                elif event.type == KEYDOWN and event.key == K_c:
                    spring_list = connect_rooms(space, G, rooms_body_list, order,phase_index)


                elif event.type == KEYDOWN and event.key == K_g:  # 判断按下g

                    rooms_shape_list_pos_out = []
                    body_type_list_out = []
                    for shape in rooms_shape_list:
                        v = shape.body.position
                        vx = int(v.x)
                        vy = int(v.y)
                        body_type = shape.body.body_type
                        shape_pos = (vx, vy)
                        rooms_shape_list_pos_out.append(shape_pos)
                        body_type_list_out.append(body_type)

                    f = open('D:\\Delft Courses\\Graduation\\PythonProject\\4_5_info_exchange.txt', mode='w',
                             encoding='utf-8')
                    f.write(f'{phase_index}')
                    f.write('\n')
                    f.write(f'{rooms_shape_list_pos_out}')
                    f.write('\n')
                    f.write(f'{body_type_list_out}')
                    f.write('\n')
                    f.write(f'{order}')
                    f.write('\n')
                    f.write(f'{rooms}')
                    f.write('\n')
                    f.write(f'{sizes}')
                    f.write('\n')
                    f.write(f'{lights}')
                    f.write('\n')
                    f.write(f'{door_direction}')
                    f.write('\n')
                    f.write(f'{circulations}')
                    f.write('\n')
                    f.write(f'{cir_Weight}')

        for shape in rooms_shape_list:
            i = rooms_shape_list.index(shape)
            v = shape.body.position
            x = order[i]
            name = G.nodes[x]['room']
            print(f'{name} pos = ', v)

        screen.fill(pygame.color.THECOLORS["white"])

        draw_map_pg(screen,pixel_list)
        draw_room(screen, G, rooms_shape_list, connection_list)
        draw_helptext(screen)

        mouse_pos = pygame.mouse.get_pos()

        mouse_body.position = mouse_pos

        space.step(1. / fps)

        # space.debug_draw(draw_options)
        pygame.display.flip()

        clock.tick(fps)
        pygame.display.set_caption("fps: " + str(clock.get_fps()))


f = open('D:\\Delft Courses\\Graduation\\PythonProject\\4_5_info_exchange.txt', mode='r', encoding='utf-8')
infolist = []
for line in f:
    infolist.append(line.strip())

phase_index = int(infolist[0]) + 1   # 0+1 = 1
rooms_shape_list_pos = eval(infolist[1])  # [(337, 367), (395, 457), (437, 357), (356, 302), (345, 447)]
body_type_list = eval(infolist[2])    #   [0, 0, 0, 0, 0]
order = eval(infolist[3])
rooms = eval(infolist[4])
sizes = eval(infolist[5])
lights = eval(infolist[6])
door_direction = eval(infolist[7])
circulations = eval(infolist[8])
cir_Weight = eval(infolist[9])


G = por_to_graph(rooms, sizes, lights, door_direction, circulations, cir_Weight)

# print("order = ", order)

# draw_graph(G)

if __name__ == '__main__':
    sys.exit(main())
# ---------- end _05_daylight_hour_optimization_module ----------

# ---- group: Generate corridor
cluster_2 = Cluster_2(input=Toggle(True))
geometry_8 = Geometry(cluster_2)

# ----
_07_path_genarator = _07_Path_genarator(input=Toggle(True))  # -> output; inputs input: list; disabled
#   port input: [required] - [type = int] - [default = None] Descripe your input here * bullet point. * bullet point
#   port output: indicate your output description here. refers to a new line.
# ---------- _07_path_genarator: Python ----------
"""
https://www.youtube.com/watch?v=JtiK0DOeI4A
"""

import pygame
import math
import numpy as np
import networkx as nx
from queue import PriorityQueue
import pymunk as pm
import numpy as np
import networkx as nx
import matplotlib.pyplot as plt
import os

import sys

import inspect
import math

import pygame
from pygame.color import *
from pygame.locals import *

import pymunk
import pymunk as pm
from pymunk.vec2d import Vec2d
import pymunk.pygame_util
import pymunk.autogeometry

WIDTH = 1600
HEIGHT = 960
WIN = pygame.display.set_mode((WIDTH,HEIGHT))



RED = (255, 0, 0)
GREEN = (0, 255, 0)
BLUE = (0, 255, 0)
YELLOW = (255, 255, 0)
WHITE = (255, 255, 255)
BLACK = (0, 0, 0)
PURPLE = (128, 0, 128)
ORANGE = (255, 165 ,0)
GREY = (128, 128, 128)
TURQUOISE = (64, 224, 208)

def draw_helptext(screen):
    font = pygame.font.Font(None, 20)
    text = ["LMB(hold): Drag shapes",
            "Initial_room_placement_module",
            "P: Pause",
            "During Pause: G: generate iteration file",
            "Esc / Q: Quit",
            "After pressing G, quit module to proceed to Daylight Daylight_hour_optimization_module"
            ]
    y = 5
    for line in text:
        text = font.render(line, 1, THECOLORS["black"])
        screen.blit(text, (5, y))
        y += 15

class Spot:
    def __init__(self, row, col, width, total_rows):
        self.row = row
        self.col = col
        self.x = row * width
        self.y = col * width
        self.color = WHITE
        self.width = width
        self.height = width
        self.total_rows = total_rows

    def get_pos(self):
        return self.row, self.col

    def is_closed(self):
        return self.color == RED

    def is_open(self):
        return self.color == GREEN

    def is_barrier(self):
        return self.color == BLACK

    def is_start(self):
        return self.color == ORANGE

    def is_end(self):
        return self.color == PURPLE

    def reset(self):
        self.color = WHITE

    def make_start(self):
        self.color = ORANGE

    def make_closed(self):
        self.color = RED

    def make_open(self):
        self.color = GREEN

    def make_barrier(self):
        self.color = BLACK

    def make_end(self):
        self.color = TURQUOISE

    def make_path(self):
        self.color = PURPLE


    def draw(self, win):
        pygame.draw.rect(win, self.color, (self.x, self.y, self.width, self.height))

    def update_neighbors(self, grid):
        self.neighbors = []
        if self.row < self.total_rows - 1 and not grid[self.row + 1][self.col].is_barrier(): # DOWN
            self.neighbors.append(grid[self.row + 1][self.col])

        if self.row > 0 and not grid[self.row - 1][self.col].is_barrier(): # UP
            self.neighbors.append(grid[self.row - 1][self.col])

        if self.col < self.total_rows - 1 and not grid[self.row][self.col + 1].is_barrier(): # RIGHT
            self.neighbors.append(grid[self.row][self.col + 1])

        if self.col > 0 and not grid[self.row][self.col - 1].is_barrier(): # LEFT
            self.neighbors.append(grid[self.row][self.col - 1])

    def __lt__(self, other):
        return False


def h(p1, p2):
    x1, y1 = p1
    x2, y2 = p2
    return abs(x1 - x2) + abs(y1 - y2)


def reconstruct_path(came_from, current, draw):
    while current in came_from:
        current = came_from[current]
        current.make_path()
        draw()


def algorithm(draw, grid, start, end):
    count = 0
    open_set = PriorityQueue()
    open_set.put((0, count, start))
    came_from = {}
    g_score = {spot: float("inf") for row in grid for spot in row}
    g_score[start] = 0
    f_score = {spot: float("inf") for row in grid for spot in row}
    f_score[start] = h(start.get_pos(), end.get_pos())

    open_set_hash = {start}

    while not open_set.empty():
        for event in pygame.event.get():
            if event.type == pygame.QUIT:
                pygame.quit()

        current = open_set.get()[2]
        open_set_hash.remove(current)

        if current == end:
            reconstruct_path(came_from, end, draw)
            end.make_end()
            return True

        for neighbor in current.neighbors:
            temp_g_score = g_score[current] + 1

            if temp_g_score < g_score[neighbor]:
                came_from[neighbor] = current
                g_score[neighbor] = temp_g_score
                f_score[neighbor] = temp_g_score + h(neighbor.get_pos(), end.get_pos())
                if neighbor not in open_set_hash:
                    count += 1
                    open_set.put((f_score[neighbor], count, neighbor))
                    open_set_hash.add(neighbor)
                    neighbor.make_open()

        draw()

        if current != start:
            current.make_closed()

    return False


def make_grid(rows, width):
    grid = []
    gap = width // rows
    for i in range(rows):
        grid.append([])
        for j in range(rows):
            spot = Spot(i, j, gap, rows)
            grid[i].append(spot)
    return grid


def draw_grid(win, rows, width, height):
    gap = width // rows
    for i in range(rows):
        pygame.draw.line(win, GREY, (0, i * gap), (width, i * gap))
        for j in range(rows):
            pygame.draw.line(win, GREY, (j * gap, 0), (j * gap, height))


def draw(win, grid, rows, width, height):
    win.fill(WHITE)

    for row in grid:
        for spot in row:
            spot.draw(win)

    draw_grid(win, rows, width, height)
    pygame.display.update()


def get_barrier_pos(pos, rows, width):
    gap = width // rows
    y, x = pos

    row = y // gap
    col = x // gap

    return row, col

def get_clicked_pos(pos, rows, width):
    gap = width // rows
    y, x = pos

    row = y // gap
    col = x // gap

    return row, col



def por_to_graph(rooms, sizes, lights, door_direction, circulations, cir_Weight):
    i_sizes = 0
    i_lights = 1
    i_weight_sum = 2
    i_edge_sum = 3
    i_door_direction = 4

    ReL_Array = np.zeros([len(rooms), len(rooms)])
    Attri_Array = np.zeros([len(rooms), i_door_direction + 1])

    # creating ReL_Array
    for i in range(len(rooms)):
        for a in range(len(circulations)):
            for b in range(len(circulations[a]) - 1):
                if circulations[a][b] == rooms[i]:
                    ReL_Array[i, rooms.index(circulations[a][b + 1])] += cir_Weight[a]

    # Flip the array left and right then rotate the array by 90 degrees
    ReL_Array = ReL_Array + np.rot90(np.fliplr(ReL_Array))
    # print("ReL_Array = ", ReL_Array)

    # Creating attribute array
    for i in range(len(rooms)):
        Attri_Array[i, i_sizes] = sizes[i]
        Attri_Array[i, i_lights] = lights[i]
    # print("Attri_Array = ", Attri_Array)

    # get Sum of edge weights on one node
    sum_weight = []
    for i in range(len(rooms)):
        sum_weight.append(sum(ReL_Array[i]))

    # Creating graph in networkx from ReL_Array
    G = nx.from_numpy_array(ReL_Array)
    for i in range(len(rooms)):
        G.nodes[i]['room'] = rooms[i]
        G.nodes[i]['sizes'] = sizes[i]
        G.nodes[i]['lights'] = lights[i]
        G.nodes[i]['sum_weight'] = sum_weight[i]
        G.nodes[i]['door_direction'] = door_direction[i]

    print("G.edges = ", G.edges(data=True))  # print edges
    print("G.nodes = ", G.nodes(data=True))  # print all nodes with attribute dictionary
    print("G.degree() = ", G.degree())
    print("sum_weight = ", sum_weight)
    return G


def crack(integer):
    start = int(np.sqrt(integer))
    factor = integer / start
    while not is_integer(factor):
        start += 1
        factor = integer / start
    return int(factor), start


def is_integer(number):
    if int(number) == number:
        return True
    else:
        return False


def main(win, width,height):
    pygame.init()

    space = pm.Space()
    space.gravity = (0.0, 0.0)
    clock = pygame.time.Clock()
    fps = 120

    ROWS = 160
    grid = make_grid(ROWS, width)



    start = None
    end = None

    run = True
    f = open('D:\\Delft Courses\\Graduation\\PythonProject\\4_5_info_exchange.txt', mode='r', encoding='utf-8')
    infolist = []
    for line in f:
        infolist.append(line.strip())

    rooms_shape_list_ops = eval(infolist[1])
    order = eval(infolist[3])
    rooms = eval(infolist[4])
    sizes = eval(infolist[5])
    lights = eval(infolist[6])
    # door_direction = eval(infolist[7])
    door_direction = ['S', 'S', 'S', 'S', 'S']
    circulations = eval(infolist[8])
    cir_Weight = eval(infolist[9])

    G = por_to_graph(rooms, sizes, lights, door_direction, circulations, cir_Weight)

    print(order)

    start_end_list = []
    stepper = 0
    path_list = []

    for i in order:  # order =  [4, 1, 0, 2, 3]
        s = G.nodes[i]['sizes']
        g = order.index(i)
        lst_len = len(order)
        room_pos = rooms_shape_list_ops[i]
        room_pos_x = rooms_shape_list_ops[i][0]
        room_pos_y = rooms_shape_list_ops[i][1]
        size = G.nodes[i]['sizes']
        d_i = G.nodes[i]['door_direction']

        if type(s) == 'tuple':
            room_width = size[0] * 10
            room_length = size[1] * 10

        else:
            ret = crack(s)
            room_width = ret[0] * 10
            room_length = ret[1] * 10

        if d_i == 'N':
            door_i_pos = (room_pos_x, room_pos_y - room_length / 2)
        elif d_i == 'S':
            door_i_pos = (room_pos_x, room_pos_y + room_length / 2)
        elif d_i == 'W':
            door_i_pos = (room_pos_x - room_width / 2, room_pos_y)
        elif d_i == 'E':
            door_i_pos = (room_pos_x + room_width / 2, room_pos_y)
        else:
            door_i_pos = (room_pos_x, room_pos_y - room_length / 2)

        row, col = get_barrier_pos(door_i_pos, ROWS, width)
        row_d_i = int(row)
        col_d_i = int(col)
        spot_i = grid[row_d_i][col_d_i]

        # room_center = (room_pos_x, room_pos_y)
        # room_corner_A = (room_pos_x - room_width / 2, room_pos_y - room_length / 2)
        # room_corner_B = (room_pos_x - room_width / 2, room_pos_y + room_length / 2)
        # room_corner_C = (room_pos_x + room_width / 2, room_pos_y + room_length / 2)
        # room_corner_D = (room_pos_x + room_width / 2, room_pos_y - room_length / 2)
        # row_center, col_center = get_barrier_pos(room_center, ROWS, width)
        # rowA, colA = get_barrier_pos(room_corner_A, ROWS, width)
        # rowB, colB = get_barrier_pos(room_corner_B, ROWS, width)
        # rowC, colC = get_barrier_pos(room_corner_C, ROWS, width)
        # rowD, colD = get_barrier_pos(room_corner_D, ROWS, width)
        # row = int(row_center)
        # col = int(col_center)
        # spot_i = grid[row][col]



        f = [n for n in G.neighbors(i)]  # getting neighbors of node i

        for i_f in range(len(f)):
            for k in order[0:g]:
                if k == f[i_f]:
                    weight = G[i][k]['weight']  # getting weight of edge connected to node i
                    sh = G.nodes[k]['sizes']
                    d_k = G.nodes[k]['door_direction']

                    ki = order.index(k)

                    if type(sh) == 'tuple':
                        room_width_k = size[0] * 10
                        room_length_k = size[1] * 10

                    else:
                        ret = crack(sh)
                        room_width_k = ret[0] * 10
                        room_length_k = ret[1] * 10

                    room_posk_x = rooms_shape_list_ops[ki][0]
                    room_posk_y = rooms_shape_list_ops[ki][1]

                    if d_k == 'N':
                        door_k_pos = (room_posk_x, room_posk_y - room_length_k / 2)
                    elif d_i == 'S':
                        door_k_pos = (room_posk_x, room_posk_y + room_length_k / 2)
                    elif d_i == 'W':
                        door_k_pos = (room_posk_x - room_width_k / 2, room_posk_y)
                    elif d_i == 'E':
                        door_k_pos = (room_posk_x + room_width_k / 2, room_posk_y)
                    else:
                        door_k_pos = (room_posk_x, room_pos_y - room_length_k / 2)

                    row_k, col_k = get_barrier_pos(door_k_pos, ROWS, width)
                    row_d_k = int(row_k)
                    col_d_k = int(col_k)
                    spot_k = grid[row_d_k][col_d_k]
                    print(row_k, col_k)

                    # room_centerk = (room_posk_x, room_posk_y)
                    # room_corner_kA = (room_pos_x - room_width / 2, room_pos_y - room_length / 2)
                    # room_corner_kB = (room_pos_x - room_width / 2, room_pos_y + room_length / 2)
                    # room_corner_kC = (room_pos_x + room_width / 2, room_pos_y + room_length / 2)
                    # room_corner_kD = (room_pos_x + room_width / 2, room_pos_y - room_length / 2)
                    # row_centerk, col_centerk = get_barrier_pos(room_centerk, ROWS, width)
                    # rowkA, colkA = get_barrier_pos(room_corner_kA, ROWS, width)
                    # rowkB, colkB = get_barrier_pos(room_corner_kB, ROWS, width)
                    # rowkC, colkC = get_barrier_pos(room_corner_kC, ROWS, width)
                    # rowkD, colkD = get_barrier_pos(room_corner_kD, ROWS, width)
                    # rowk = int(row_centerk)
                    # colk = int(col_centerk)
                    # spot_k = grid[rowk][colk]
                    start_end_list.append([spot_i, spot_k])
                else:
                    pass

    print(start_end_list)

    while run:
        draw(win, grid, ROWS, width, height)


        for event in pygame.event.get():
            if event.type == KEYUP:
                if event.key == K_p:
                    pause = True
            if event.type == QUIT:
                exit()
            elif event.type == KEYDOWN and event.key == K_ESCAPE:
                exit()

            if pygame.mouse.get_pressed()[0]: # LEFT
                pos = pygame.mouse.get_pos()
                row, col = get_clicked_pos(pos, ROWS, width)
                spot = grid[row][col]
                if not start and spot != end:
                    start = spot
                    start.make_start()

                elif not end and spot != start:
                    end = spot
                    end.make_end()

                elif spot != end and spot != start:
                    spot.make_barrier()

            elif pygame.mouse.get_pressed()[2]: # RIGHT
                pos = pygame.mouse.get_pos()
                row, col = get_clicked_pos(pos, ROWS, width)
                spot = grid[row][col]
                spot.reset()
                if spot == start:
                    start = None
                elif spot == end:
                    end = None

            if event.type == pygame.KEYDOWN:
                if event.key == pygame.K_d:
                    spot_s = start_end_list[stepper][0]
                    start = spot_s
                    spot_s.make_start()
                    spot_e = start_end_list[stepper][1]
                    end = spot_e
                    spot_e.make_end()
                    stepper = stepper + 1
                if event.key == pygame.K_SPACE:
                    for row in grid:
                        for spot in row:
                            spot.update_neighbors(grid)

                    algorithm(lambda: draw(win, grid, ROWS, width, height), grid, start, end)

                if event.key == pygame.K_c:
                    start = None
                    end = None
                    grid = make_grid(ROWS, width)

                if event.key == pygame.K_g:
                    temp_list = []
                    for i in range(160):
                        for j in range(96):
                            # spot = grid[i][j]
                            if grid[i][j].color == PURPLE:
                                temp_list.append([i,j])
                            else:
                                pass
                    path_list.append(temp_list)


                if event.key == pygame.K_o:
                    f = open('D:\\Delft Courses\\Graduation\\PythonProject\\7_path_info_exchange.txt', mode='w', encoding='utf-8')
                    f.write(f'{path_list}')


                if event.key == pygame.K_b:
                    for i in range(len(order)):
                        node = order[i]
                        room_pos = rooms_shape_list_ops[i]
                        room_pos_x = rooms_shape_list_ops[i][0]
                        room_pos_y = rooms_shape_list_ops[i][1]
                        size = G.nodes[node]['sizes']

                        if type(size) == 'tuple':
                            room_width = size[0] * 10
                            room_length = size[1] * 10

                        else:
                            ret = crack(size)
                            room_width = ret[0] * 10
                            room_length = ret[1] * 10

                        room_corner_A = (room_pos_x - room_width / 2, room_pos_y - room_length / 2)
                        room_corner_B = (room_pos_x - room_width / 2, room_pos_y + room_length / 2)
                        room_corner_C = (room_pos_x + room_width / 2, room_pos_y + room_length / 2)
                        room_corner_D = (room_pos_x + room_width / 2, room_pos_y - room_length / 2)
                        rowA, colA = get_barrier_pos(room_corner_A, ROWS, width)
                        rowB, colB = get_barrier_pos(room_corner_B, ROWS, width)
                        rowC, colC = get_barrier_pos(room_corner_C, ROWS, width)
                        rowD, colD = get_barrier_pos(room_corner_D, ROWS, width)
                        # print((rowA, colA),(rowB, colB),(rowC, colC),(rowD, colD))

                        for j in range(int(colB - colA)):
                            for i in range(int(rowD - rowA)):
                                row = int(rowA + i)
                                col = int(colA + j)
                                spot = grid[row][col]
                                spot.make_barrier()


        space.step(1. / fps)




        clock.tick(fps)

        pygame.display.set_caption("fps: " + str(clock.get_fps()))


    pygame.quit()


main(WIN, WIDTH, HEIGHT)
# ---------- end _07_path_genarator ----------

# ==== cluster Cluster
input = ClusterInput()
gh_cpython = GH_CPython(input=input)  # -> ax_list, ay_list, bx_list, by_list, cx_list, cy_list, dx_list, dy_list, name_list, light_list; inputs input: list
#   port input: [required] - [type = int] - [default = None] Descripe your input here * bullet point. * bullet point
#   port ax_list: indicate your output description here. refers to a new line.
# ---------- gh_cpython: Python ----------
import numpy as np
import networkx as nx

def por_to_graph(rooms, sizes, lights, door_direction, circulations, cir_Weight):
    i_sizes = 0
    i_lights = 1
    i_weight_sum = 2
    i_edge_sum = 3
    i_door_direction = 4

    ReL_Array = np.zeros([len(rooms), len(rooms)])
    Attri_Array = np.zeros([len(rooms), i_door_direction + 1])

    # creating ReL_Array
    for i in range(len(rooms)):
        for a in range(len(circulations)):
            for b in range(len(circulations[a]) - 1):
                if circulations[a][b] == rooms[i]:
                    ReL_Array[i, rooms.index(circulations[a][b + 1])] += cir_Weight[a]

    # Flip the array left and right then rotate the array by 90 degrees
    ReL_Array = ReL_Array + np.rot90(np.fliplr(ReL_Array))
    # print("ReL_Array = ", ReL_Array)

    # Creating attribute array
    for i in range(len(rooms)):
        Attri_Array[i, i_sizes] = sizes[i]
        Attri_Array[i, i_lights] = lights[i]
    # print("Attri_Array = ", Attri_Array)

    # get Sum of edge weights on one node
    sum_weight = []
    for i in range(len(rooms)):
        sum_weight.append(sum(ReL_Array[i]))

    # Creating graph in networkx from ReL_Array
    G = nx.from_numpy_array(ReL_Array)
    for i in range(len(rooms)):
        G.nodes[i]['room'] = rooms[i]
        G.nodes[i]['sizes'] = sizes[i]
        G.nodes[i]['lights'] = lights[i]
        G.nodes[i]['sum_weight'] = sum_weight[i]
        G.nodes[i]['door_direction'] = door_direction[i]

    print("G.edges = ", G.edges(data=True))  # print edges
    print("G.nodes = ", G.nodes(data=True))  # print all nodes with attribute dictionary
    print("G.degree() = ", G.degree())
    print("sum_weight = ", sum_weight)
    return G
# ↑ done, returns a graph contains all information, weights on edges, attributes on nodes

def crack(integer):
    start = int(np.sqrt(integer))
    factor = integer / start
    while not is_integer(factor):
        start += 1
        factor = integer / start
    return int(factor), start

def is_integer(number):
    if int(number) == number:
        return True
    else:
        return False






f = open('D:\\Delft Courses\\Graduation\\PythonProject\\4_5_info_exchange.txt', mode='r', encoding='utf-8')
infolist = []
for line in f:
    infolist.append(line.strip())

phase_index = int(infolist[0]) + 1   # 0+1 = 1
rooms_shape_list_pos = eval(infolist[1])  # [(337, 367), (395, 457), (437, 357), (356, 302), (345, 447)]
body_type_list = eval(infolist[2])    #   [0, 0, 0, 0, 0]
order = eval(infolist[3])
rooms = eval(infolist[4])
sizes = eval(infolist[5])
lights = eval(infolist[6])
door_direction = eval(infolist[7])
circulations = eval(infolist[8])
cir_Weight = eval(infolist[9])

G = por_to_graph(rooms, sizes, lights, door_direction, circulations, cir_Weight)


ax_list = []
ay_list = []
bx_list = []
by_list = []
cx_list = []
cy_list = []
dx_list = []
dy_list = []
name_list = []
light_list = []

for node in order[0:phase_index]:
    i = order.index(node)
    name = G.nodes[node]['room']
    light = G.nodes[node]['lights']
    name_list.append(name)
    light_list.append(light)
    size = G.nodes[node]['sizes']
    if type(size) == 'tuple':
        room_width = size[0]
        room_length = size[1]

    else:
        ret = crack(size)  # crack room size into two closest factors
        room_width = ret[0]
        room_length = ret[1]
    pos_x = rooms_shape_list_pos[i][0]/10
    pos_y = (960-rooms_shape_list_pos[i][1])/ 10

    cornerA = (pos_x - room_width/2, pos_y - room_length/2, 0)
    cornerB = (pos_x - room_width / 2, pos_y + room_length / 2, 0)
    cornerC = (pos_x + room_width / 2, pos_y + room_length / 2, 0)
    cornerD = (pos_x + room_width / 2, pos_y - room_length / 2, 0)
    ax_list.append(cornerA[0])
    ay_list.append(cornerA[1])
    bx_list.append(cornerB[0])
    by_list.append(cornerB[1])
    cx_list.append(cornerC[0])
    cy_list.append(cornerC[1])
    dx_list.append(cornerD[0])
    dy_list.append(cornerD[1])
# ---------- end gh_cpython ----------
light_list = ClusterOutput(gh_cpython.light_list)
name_list = ClusterOutput(gh_cpython.name_list)
construct_point = ConstructPoint(XCoordinate=gh_cpython.ax_list, YCoordinate=gh_cpython.ay_list, ZCoordinate=0)
construct_point_2 = ConstructPoint(XCoordinate=gh_cpython.bx_list, YCoordinate=gh_cpython.by_list, ZCoordinate=0)
construct_point_3 = ConstructPoint(XCoordinate=gh_cpython.dx_list, YCoordinate=gh_cpython.dy_list, ZCoordinate=0)
construct_point_4 = ConstructPoint(XCoordinate=gh_cpython.cx_list, YCoordinate=gh_cpython.cy_list, ZCoordinate=0)
number_slider = Slider(3, range=0..10)
construct_point_5 = ConstructPoint(XCoordinate=gh_cpython.ax_list, YCoordinate=gh_cpython.ay_list, ZCoordinate=number_slider)
colour_rgb = ColourRGB(Alpha=255, Red=Slider(255, range=0..255), Green=Slider(255, range=0..255), Blue=Slider(255, range=0..255))
colour = ClusterOutput(colour_rgb)
_4point_surface = _4PointSurface(CornerA=construct_point, CornerB=construct_point_2, CornerC=construct_point_4, CornerD=construct_point_3)
unit_z = UnitZ(Factor=number_slider)
construct_point_6 = ConstructPoint(XCoordinate=0, YCoordinate=0, ZCoordinate=0)
unit_z_2 = UnitZ(Factor=1)
area = Area(Geometry=_4point_surface)  # -> Area, Centroid
extrude = Extrude(Base=_4point_surface, Direction=unit_z)
line_sdl = LineSDL(Start=construct_point_6, Direction=unit_z_2, Length=1)
rotate_axis = RotateAxis(Geometry=area.Centroid, Angle=degrees("-26"), Axis=line_sdl)  # -> Geometry, Transform
rotate_axis_2 = RotateAxis(Geometry=construct_point_5, Angle=degrees("-26"), Axis=line_sdl)  # -> Geometry, Transform
rotate_axis_3 = RotateAxis(Geometry=extrude, Angle=degrees("-26"), Axis=line_sdl)  # -> Geometry, Transform
geometry = ClusterOutput(rotate_axis.Geometry)
geometry_2 = ClusterOutput(rotate_axis_2.Geometry)
geometry_3 = ClusterOutput(rotate_axis_3.Geometry)

# ==== cluster Cluster_2
input = ClusterInput()
gh_cpython = GH_CPython(input=input)  # -> x_list, len_x, y_list, len_y; inputs input: list
#   port input: [required] - [type = int] - [default = None] Descripe your input here * bullet point. * bullet point
#   port x_list: indicate your output description here. refers to a new line.
# ---------- gh_cpython: Python ----------
f = open('D:\\Delft Courses\\Graduation\\PythonProject\\7_path_info_exchange.txt', mode='r', encoding='utf-8')

infolist = []

for line in f:
    infolist.append(line.strip())

path = eval(infolist[0])
x_list = []
y_list = []


for i in range(len(path)):
    x_list_temp = []
    y_list_temp = []
    for j in range(len(path[i])):
        x = path[i][j][0]
        y = 96 - path[i][j][1]
        x_list_temp.append(x)
        y_list_temp.append(y)
    x_list.append(x_list_temp)
    y_list.append(y_list_temp)

len_x = len(x_list)
len_y = len(y_list)

print(x_list)
print(y_list)
# ---------- end gh_cpython ----------
construct_point = ConstructPoint(XCoordinate=0, YCoordinate=0, ZCoordinate=0)
unit_z = UnitZ(Factor=1)
partition_list = PartitionList(List=gh_cpython.x_list, Size=gh_cpython.len_x)
partition_list_2 = PartitionList(List=gh_cpython.y_list, Size=gh_cpython.len_y)
unit_x = UnitX(Factor=Slider(1, range=-10..10))
unit_y = UnitY(Factor=Slider(-1, range=-10..10))
line_sdl = LineSDL(Start=construct_point, Direction=unit_z, Length=1)
construct_point_2 = ConstructPoint(XCoordinate=partition_list, YCoordinate=partition_list_2, ZCoordinate=0)
move = Move(Geometry=construct_point_2, Motion=unit_x)  # -> Geometry, Transform
move_2 = Move(Geometry=move.Geometry, Motion=unit_y)  # -> Geometry, Transform
rotate_axis = RotateAxis(Geometry=move_2.Geometry, Angle=degrees("-26"), Axis=line_sdl)  # -> Geometry, Transform
geometry = ClusterOutput(rotate_axis.Geometry)
